# Grasshopper definition weibull.gh (Grasshopper 1.0.7)

file = ReadFile(File="C:\Users\pkastner\Documents\GitHub\weibull\ws.csv", PerLineParse=True)
c_script = CSharpScript(ws=file, Reference="C:\Users\pkastner\Documents\GitHub\Eddy3d\Eddy\bin\MathNet.Numerics.dll")  # -> out, est, wb_new; inputs ws: list of Double
# ---------- c_script: C# usings ----------
using MathNet.Numerics.Distributions;
using System.Linq;
# ---------- c_script: C# ----------
    

    var estimated = Weibull.Estimate(ws);

    var wb = new Weibull(estimated.Shape, estimated.Scale);

    est = estimated;
    wb_new = wb;
# ---------- end c_script ----------
panel = Panel(c_script.est)
panel_2 = Panel(c_script.wb_new)
bar_graph = BarGraph(file, BarColor=RGB(255, 0, 90))
